# Grasshopper definition bridge_hex_2.gh (Grasshopper 1.0.7)

crv = Curve(<curve referenced from the Rhino model>)
divide = DivideCurve(Curve=crv, Count=Slider(6, range=0..100), Kinks=False)  # -> Points, Tangents, Parameters
slider = Slider(0.5, range=0..1)
slider_2 = Slider(1, range=0..100)
secciones_circulos = Slider(8, range=0..100)
radio_circulo_central = Slider(3, range=0..100)
multiplication = Multiplication(A=slider_2, B=-1)
line = LineSDL(Start=divide.Points, Direction=divide.Tangents, Length=slider_2)
line_2 = LineSDL(Start=divide.Points, Direction=divide.Tangents, Length=multiplication)
multiplication_2 = Multiplication(A=slider_2, B=slider)
multiplication_3 = Multiplication(A=multiplication, B=slider)
end = EndPoints(Curve=line_2)  # -> Start, End
end_2 = EndPoints(Curve=line)  # -> Start, End
circle = CircleCNR(Center=end_2.End, Normal=divide.Tangents, Radius=radio_circulo_central)
Z = UnitZ(Factor=1)
circle_2 = CircleCNR(Center=end.End, Normal=divide.Tangents, Radius=radio_circulo_central)
x_tremez = Extremes(Curve=circle_2, Plane=Z)  # -> Highest, Lowest
x_tremez_2 = Extremes(Curve=circle, Plane=Z)  # -> Highest, Lowest
crv_cp = CurveCP(Point=x_tremez.Highest, Curve=circle_2)  # -> Point, Parameter, Distance
crv_cp_2 = CurveCP(Point=x_tremez_2.Highest, Curve=circle)  # -> Point, Parameter, Distance
seam = Seam(Curve=circle_2, Seam=crv_cp.Parameter)
seam_2 = Seam(Curve=circle, Seam=crv_cp_2.Parameter)
divide_2 = DivideCurve(Curve=seam, Count=secciones_circulos, Kinks=False)  # -> Points, Tangents, Parameters
divide_3 = DivideCurve(Curve=seam_2, Count=secciones_circulos, Kinks=False)  # -> Points, Tangents, Parameters
pline = PolyLine(Vertices=divide_3.Points, Closed=True)
pline_2 = PolyLine(Vertices=divide_2.Points, Closed=True)
ln = Line(StartPoint=divide_2.Points, EndPoint=divide_3.Points)
explode = Explode(Curve=pline, Recursive=True)  # -> Segments, Vertices
explode_2 = Explode(Curve=pline_2, Recursive=True)  # -> Segments, Vertices
shift = ShiftList(List=ln, Shift=1, Wrap=True)
curvepoint = PointOnCurve(explode_2.Segments, parameter=0.498)
curvepoint_2 = PointOnCurve(explode.Segments, parameter=0.498)
end_3 = EndPoints(Curve=shift)  # -> Start, End
end_4 = EndPoints(Curve=ln)  # -> Start, End
line_3 = LineSDL(Start=curvepoint, Direction=graft(divide.Tangents), Length=multiplication_3)
line_4 = LineSDL(Start=curvepoint_2, Direction=graft(divide.Tangents), Length=multiplication_2)
end_5 = EndPoints(Curve=line_4)  # -> Start, End
end_6 = EndPoints(Curve=line_3)  # -> Start, End
ln_2 = Line(StartPoint=end_6.End, EndPoint=end_4.Start)  # -> simplify(Line)
ln_3 = Line(StartPoint=end_5.End, EndPoint=end_4.End)  # -> simplify(Line)
ln_4 = Line(StartPoint=end_6.End, EndPoint=end_3.Start)  # -> simplify(Line)
ln_5 = Line(StartPoint=end_5.End, EndPoint=end_3.End)  # -> simplify(Line)
join = JoinCurves(Curves=[ln_2, ln_4], Preserve=False)  # -> simplify(Curves)
join_2 = JoinCurves(Curves=[ln_3, ln_5], Preserve=False)  # -> simplify(Curves)
viewer = ParamViewer(join)
replace = ReplaceBranches(Data=join, Search=viewer, Replace=reverse(viewer))
relitem = RelativeItem(Tree=join_2, Offset="{1}", WrapPaths=False, WrapItems=False)  # -> ItemA, ItemB
relitem_2 = RelativeItem(Tree=replace, Offset="{1}", WrapPaths=False, WrapItems=False)  # -> ItemA, ItemB
viewer_2 = ParamViewer(relitem_2.ItemA)
slider_3 = Slider(2.411, range=0..100)
replace_2 = ReplaceBranches(Data=relitem_2.ItemA, Search=viewer_2, Replace=reverse(viewer_2))
cp = ControlPoints(Curve=join)  # -> Points, Weights, Knots
cp_2 = ControlPoints(Curve=join_2)  # -> Points, Weights, Knots
pcen = PolygonCenter(Polyline=join)  # -> CenterV, CenterE
pcen_2 = PolygonCenter(Polyline=join_2)  # -> CenterV, CenterE
crv_2 = Curve(replace_2)
crv_3 = Curve(relitem.ItemA)
cp_3 = ControlPoints(Curve=crv_3)  # -> Points, Weights, Knots
cp_4 = ControlPoints(Curve=crv_2)  # -> Points, Weights, Knots

scale = Scale(Geometry=join, Center=pcen.CenterV, Factor=slider_3)  # -> Geometry, Transform
scale_2 = Scale(Geometry=join_2, Center=pcen_2.CenterV, Factor=slider_3)  # -> Geometry, Transform

viewer_3 = ParamViewer(scale.Geometry)
dispatch = Dispatch(List=cp_3.Points, DispatchPattern=[True, False])  # -> ListA, ListB
dispatch_2 = Dispatch(List=cp_4.Points, DispatchPattern=[True, False])  # -> ListA, ListB
replace_3 = ReplaceBranches(Data=scale.Geometry, Search=viewer_3, Replace=reverse(viewer_3))
cp_5 = ControlPoints(Curve=scale.Geometry)  # -> Points, Weights, Knots
cp_6 = ControlPoints(Curve=scale_2.Geometry)  # -> Points, Weights, Knots
relitem_3 = RelativeItem(Tree=scale_2.Geometry, Offset="{1}", WrapPaths=False, WrapItems=False)  # -> ItemA, ItemB
relitem_4 = RelativeItem(Tree=replace_3, Offset="{1}", WrapPaths=False, WrapItems=False)  # -> ItemA, ItemB
dispatch_3 = Dispatch(List=cp_5.Points, DispatchPattern=[True, False])  # -> ListA, ListB
dispatch_4 = Dispatch(List=cp_6.Points, DispatchPattern=[True, False])  # -> ListA, ListB
viewer_4 = ParamViewer(relitem_4.ItemA)
replace_4 = ReplaceBranches(Data=relitem_4.ItemA, Search=viewer_4, Replace=reverse(viewer_4))
crv_4 = Curve(replace_4)
crv_5 = Curve(relitem_3.ItemA)
cp_7 = ControlPoints(Curve=crv_5)  # -> Points, Weights, Knots
cp_8 = ControlPoints(Curve=crv_4)  # -> Points, Weights, Knots
dispatch_5 = Dispatch(List=cp_7.Points, DispatchPattern=[True, False])  # -> ListA, ListB
dispatch_6 = Dispatch(List=cp_8.Points, DispatchPattern=[True, False])  # -> ListA, ListB
line_5 = Line(simplify(ln))
ln_6 = Line(StartPoint=cp_5.Points, EndPoint=cp.Points)  # -> simplify(Line)
explode_3 = Explode(Curve=[scale.Geometry, scale_2.Geometry], Recursive=True)  # -> Segments, Vertices
explode_4 = Explode(Curve=[join, join_2], Recursive=True)  # -> Segments, Vertices
ln_7 = Line(StartPoint=dispatch_3.ListB, EndPoint=dispatch_4.ListB)  # -> simplify(Line)
ln_8 = Line(StartPoint=cp_6.Points, EndPoint=cp_2.Points)  # -> simplify(Line)
ln_9 = Line(StartPoint=dispatch_5.ListA, EndPoint=dispatch_6.ListA)
ln_10 = Line(StartPoint=dispatch.ListA, EndPoint=dispatch_2.ListA)
pt = Point(explode_4.Vertices)
pt_2 = Point(explode_3.Vertices)
line_6 = Line(flatten([ln_10, ln_9, ln_7, line_5, ln_6, ln_8, explode_3.Segments, explode_4.Segments]))
len = Length(Curve=line_6)
